# Grasshopper definition packing_model_gen1 3d sim4 3trees addgen2 fix3pts.gh (Grasshopper 1.0.7)
# plug-ins: Kangaroo2 Components

panel = Panel("""4
4.09793700000000
4
3.90206600000000
4.09793700000000
3.63505200000000
4.09793700000000
4.65401800000000
3.90206600000000
3.34598500000000
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""")
panel_2 = Panel("""0.00433500000000000
1.42836000000000
0.00433500000000000
1.42836000000000
1.42836000000000
2.15575900000000
1.42836000000000
2.15575900000000
1.42836000000000
2.15575800000000
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""")
panel_3 = Panel("""1.49840000000000e-09
-0.518693000000000
1.49840000000000e-09
0.518694000000000
-0.518693000000000
-0.861685000000000
-0.518693000000000
-0.669292000000000
0.518694000000000
0.669294000000000
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""")
panel_4 = Panel("""0.00433500000000000
1.42836000000000
0.00433500000000000
1.42836000000000
1.42836000000000
2.15575900000000
1.42836000000000
2.15575800000000
1.42836000000000
2.15575900000000
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""")
panel_5 = Panel("""4
3.49376400000000
4
4.50623600000000
3.49376400000000
3.10602100000000
3.49376400000000
3.39977000000000
4.50623600000000
4.60023000000000
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""")
panel_6 = Panel("""2
2.14952900000000
2
1.85046900000000
2.14952900000000
1.72342900000000
2.14952900000000
2.71792300000000
1.85046900000000
1.28207500000000
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""")
panel_7 = Panel("""1.10840000000000e-10
0.0295940000000000
1.10840000000000e-10
-0.0295940000000000
0.0295940000000000
-0.473663000000000
0.0295940000000000
0.561009000000000
-0.0295940000000000
-0.561009000000000
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""")
panel_8 = Panel("""0.00217100000000000
1.42642200000000
0.00217100000000000
1.42642200000000
1.42642200000000
2.15418500000000
1.42642200000000
2.15418500000000
1.42642200000000
2.15418500000000
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""")
panel_9 = Panel("tree 3")
panel_10 = Panel("""1.73330000000000e-10
-0.526985000000000
1.73330000000000e-10
0.526985000000000
-0.526985000000000
-0.806743000000000
-0.526985000000000
-0.748638000000000
0.526985000000000
0.748639000000000
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""")
panel_11 = Panel("tree 2")
panel_12 = Panel("tree 1")
pt = ConstructPoint(XCoordinate=panel_5, YCoordinate=panel_6, ZCoordinate=panel_2)
pt_2 = ConstructPoint(XCoordinate=panel_3, YCoordinate=panel, ZCoordinate=panel_4)
# initial tree family coordinates
pt_3 = ConstructPoint(XCoordinate=panel_10, YCoordinate=panel_7, ZCoordinate=panel_8)
dom = ConstructDomain(DomainStart=Slider(-3, range=-20..0), DomainEnd=Slider(6.5, range=0..20))
dom_2 = ConstructDomain(DomainStart=Slider(-3, range=-20..0), DomainEnd=Slider(6.5, range=-10..20))
dom_3 = ConstructDomain(DomainStart=0, DomainEnd=Slider(3, range=0..5))
merge = Merge(Data1=pt_3, Data2=pt, Data3=pt_2)
box = DomainBox(Base=PlaneXY(0, 0, 0), X=dom, Y=dom_2, Z=dom_3)
# create edges between nodes
dispatch = Dispatch(List=merge, DispatchPattern=[True, False])  # -> ListA, ListB
cullpt = CullDuplicates(Points=flatten(merge), Tolerance=0.1, CullMode=3)  # -> Points, Indices, Valence
panel_13 = Panel("get unique vertices")
# vertical load on vertices
number_slider = Slider(0.5, range=0..2)
number_slider_2 = Slider(1, range=0..1.4)
ln = Line(StartPoint=dispatch.ListA, EndPoint=dispatch.ListB)
panel_14 = Panel("scaleable cuboid enclosure")
dom_4 = ConstructDomain(DomainStart="-2", DomainEnd=1)
dom_5 = ConstructDomain(DomainStart="3", DomainEnd=10)
panel_15 = Panel("""0
1
3
60
61
63
120
121
123""")
number_slider_3 = Slider(0.8, range=0..1)
show = Show(G=ln)
# vertices are spheres that collide with each other
number_slider_4 = Slider(1000, range=0..1000)
planesrf = PlaneSurface(Plane=PlaneXY(0, 0, 0), XSize=dom_4, YSize=dom_5)
vec = VectorXYZ(XComponent=0, YComponent=0, ZComponent=number_slider)  # -> Vector, Length
item = ListItem(List=merge, Index=panel_15, Wrap=True)
panel_16 = Panel("edges are elastic")
length_line = LengthLine(Line=ln, Strength=Slider(19.88, range=0..100))
show_2 = Show(G=cullpt.Points)
sc = SphereCollide(Points=cullpt.Points, Radius=number_slider_3, Strength=Slider(0.8, range=0..1))
load = Load(Point=cullpt.Points, ForceVector=vec.Vector)
scale_nu = ScaleNU(Geometry=box, Plane=planesrf, ScaleX=number_slider_2, ScaleY=number_slider_2, ScaleZ=Slider(1, range=0..3.1))  # -> Geometry, Transform
# anchor great-grandparent nodes in z
anchorxyz = AnchorXYZ(Point=item, X=True, Y=True, Z=True, Strength=number_slider_4)
# keep tree vertices inside cuboid
mbox = MeshBox(Base=scale_nu.Geometry, XCount=10, YCount=10, ZCount=10)
# click to reset model
button = Button()
# hold to run model
button_2 = Button()
spc = SolidPointCollide(Points=cullpt.Points, Solid=mbox, Interior=True, Unidirectional=True, Strength=Slider(100, range=0..1000))
entwine = Entwine(Branch00=[length_line, sc, load, spc, anchorxyz], Branch01=show_2, Branch02=show, FlattenInputs=True)
panel_17 = Panel("""------------
model solver
------------""")
solver = Solver(GoalObjects=entwine, Reset=button, Threshold=1e-15, Tolerance=0.01, On=button_2)  # -> I, V, O
division = Division(A=number_slider_3, B=Slider(1.303, range=1..2))
# enable to draw pipes around edges to aid visualization
bang = ExplodeTree(Data=solver.O)  # -> Branch0, Branch1, Branch2
msphere = MeshSphere(Base=PlaneXY(0, 0, 0), Radius=division, UCount=10, VCount=20)
panel_18 = Panel("Read output xyz")
pdecon = Deconstruct(Point=bang.Branch1)  # -> XComponent, YComponent, ZComponent
pipe = Pipe(Curve=bang.Branch2, Radius=Slider(0.123, range=0..0.3), Caps=2)  # -> flatten(Pipe)
# enable to check how large vertex spheres are
move = Move(Geometry=msphere, Motion=bang.Branch1)  # -> Geometry, Transform; disabled
panel_19 = Panel(pdecon.YComponent)
panel_20 = Panel(pdecon.XComponent)
panel_21 = Panel(pdecon.ZComponent)
mjoin = MeshJoin(Meshes=pipe)
