# Grasshopper definition packing_model_gen1 3d sim4 3trees gen2 flattrees fix7pts.gh (Grasshopper 1.0.7)
# plug-ins: Kangaroo2 Components

# initial tree family coordinates
panel = Panel("""-2.40000000000000e-05
0.922243000000000
-2.40000000000000e-05
-0.921228000000000
0.922243000000000
0.387171000000000
0.922243000000000
1.57637500000000
-0.921228000000000
-1.74346700000000
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""")
panel_2 = Panel("""-3.40000000000000e-05
0.380937000000000
-3.40000000000000e-05
-0.398542000000000
0.380937000000000
1.09146900000000
0.380937000000000
-0.221816000000000
-0.398542000000000
-0.0567980000000000
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""")
panel_3 = Panel("""4.00006600000000
4.26133500000000
4.00006600000000
3.95432200000000
4.26133500000000
5.09960500000000
4.26133500000000
3.37192200000000
3.95432200000000
4.80050100000000
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""")
panel_4 = Panel("""0.000231000000000000
1.00523500000000
0.000231000000000000
1.00469700000000
1.00523500000000
1.00517500000000
1.00523500000000
1.00500000000000
1.00469700000000
1.00499900000000
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""")
panel_5 = Panel("""0.000494000000000000
1.00449500000000
0.000494000000000000
1.00506200000000
1.00449500000000
1.00499900000000
1.00449500000000
1.00499900000000
1.00506200000000
1.00500000000000
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""")
panel_6 = Panel("tree 3")
panel_7 = Panel("""-4.20000000000000e-05
0.966774000000000
-4.20000000000000e-05
-1.00102400000000
0.966774000000000
1.26426400000000
0.966774000000000
0.962720000000000
-1.00102400000000
-1.27564100000000
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""")
panel_8 = Panel("""2.00000300000000
1.47826900000000
2.00000300000000
2.55003100000000
1.47826900000000
2.07068500000000
1.47826900000000
0.600108000000000
2.55003100000000
3.41349900000000
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""")
panel_9 = Panel("""0
    1.0000
         0
    1.0000
    1.0000
    1.7071
    1.0000
    1.7071
    1.0000
    1.7071
    1.0000
    1.7071
    1.7071
    2.2845
    1.7071
    2.2845
    1.7071
    2.2845
    1.7071
    2.2845
    1.7071
    2.2845
    1.7071
    2.2845
    1.7071
    2.2845
    1.7071
    2.2845""")
panel_10 = Panel("""0.000444000000000000
1.00492000000000
0.000444000000000000
1.00487100000000
1.00492000000000
1.00500000000000
1.00492000000000
1.00519300000000
1.00487100000000
1.00500000000000
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""")
panel_11 = Panel("""4
5
4
3
5
5
5
5
3
3
3
3
5
5.3333
5
4.6667
5
5.3333
5
4.6667
3
3.3333
3
2.6667
3
3.3333
3
2.6667""")
panel_12 = Panel("""4.00
4.00
4.00
4.00
4.00
4.50
4.00
3.50
4.00
4.50
4.00
3.50
4.50
4.50
4.50
4.50
3.50
3.50
3.50
3.50
4.50
4.50
4.50
4.50
3.50
3.50
3.50
3.50""")
panel_13 = Panel("""4.00009000000000
4.86043400000000
4.00009000000000
3.16494600000000
4.86043400000000
5.52550200000000
4.86043400000000
5.01184400000000
3.16494600000000
3.37961500000000
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""")
panel_14 = Panel("tree 4")
panel_15 = Panel("tree 2")
pt = ConstructPoint(XCoordinate=panel, YCoordinate=panel_2, ZCoordinate=panel_4)
pt_2 = ConstructPoint(XCoordinate=panel_13, YCoordinate=panel_8, ZCoordinate=panel_5)
pt_3 = ConstructPoint(XCoordinate=panel_7, YCoordinate=panel_3, ZCoordinate=panel_10)
pt_4 = ConstructPoint(XCoordinate=panel_11, YCoordinate=panel_12, ZCoordinate=panel_9)  # disabled
dom = ConstructDomain(DomainStart=Slider(-6.475, range=-20..0), DomainEnd=Slider(9.975, range=0..20))
dom_2 = ConstructDomain(DomainStart=Slider(-6.475, range=-20..0), DomainEnd=Slider(9.975, range=-10..20))
dom_3 = ConstructDomain(DomainStart=0, DomainEnd=Slider(1, range=0..5))
merge = Merge(Data1=pt, Data2=pt_2, Data3=pt_3)
panel_16 = Panel("get unique vertices")
cullpt = CullDuplicates(Points=flatten(merge), Tolerance=0.1, CullMode=3)  # -> Points, Indices, Valence
# create edges between nodes
dispatch = Dispatch(List=merge, DispatchPattern=[True, False])  # -> ListA, ListB
box = DomainBox(Base=PlaneXY(0, 0, 0), X=dom, Y=dom_2, Z=dom_3)
# vertical load on vertices
number_slider = Slider(0.5, range=0..2)
number_slider_2 = Slider(1, range=0..1.4)
ln = Line(StartPoint=dispatch.ListA, EndPoint=dispatch.ListB)
number_slider_3 = Slider(0.8, range=0..1)
panel_17 = Panel("scaleable cuboid enclosure")
panel_18 = Panel("""0
1
2
3
4
5
6
60
61
62
63
64
65
66
120
121
122
123
124
125
126""")
dom_4 = ConstructDomain(DomainStart="-2", DomainEnd=1)
dom_5 = ConstructDomain(DomainStart="3", DomainEnd=10)
show = Show(G=ln)
# vertices are spheres that collide with each other
number_slider_4 = Slider(1000, range=0..1000)
planesrf = PlaneSurface(Plane=PlaneXY(0, 0, 0), XSize=dom_4, YSize=dom_5)
item = ListItem(List=merge, Index=panel_18, Wrap=True)
vec = VectorXYZ(XComponent=0, YComponent=0, ZComponent=number_slider)  # -> Vector, Length
length_line = LengthLine(Line=ln, Strength=Slider(19.88, range=0..100))
panel_19 = Panel("edges are elastic")
sc = SphereCollide(Points=cullpt.Points, Radius=number_slider_3, Strength=Slider(0.8, range=0..1))
show_2 = Show(G=cullpt.Points)
load = Load(Point=cullpt.Points, ForceVector=vec.Vector)
scale_nu = ScaleNU(Geometry=box, Plane=planesrf, ScaleX=number_slider_2, ScaleY=number_slider_2, ScaleZ=Slider(1, range=0..3.1))  # -> Geometry, Transform
# anchor great-grandparent nodes in z
anchorxyz = AnchorXYZ(Point=item, X=True, Y=True, Z=True, Strength=number_slider_4)
# keep tree vertices inside cuboid
mbox = MeshBox(Base=scale_nu.Geometry, XCount=10, YCount=10, ZCount=10)
spc = SolidPointCollide(Points=cullpt.Points, Solid=mbox, Interior=True, Unidirectional=True, Strength=Slider(100, range=0..1000))
# click to reset model
button = Button()
# hold to run model
button_2 = Button()
entwine = Entwine(Branch00=[length_line, sc, load, spc, anchorxyz], Branch01=show_2, Branch02=show, FlattenInputs=True)
panel_20 = Panel("""------------
model solver
------------""")
solver = Solver(GoalObjects=entwine, Reset=button, Threshold=1e-15, Tolerance=0.01, On=button_2)  # -> I, V, O
division = Division(A=number_slider_3, B=Slider(1.303, range=1..2))
# enable to draw pipes around edges to aid visualization
bang = ExplodeTree(Data=solver.O)  # -> Branch0, Branch1, Branch2
msphere = MeshSphere(Base=PlaneXY(0, 0, 0), Radius=division, UCount=10, VCount=20)
panel_21 = Panel("Read output xyz")
pipe = Pipe(Curve=bang.Branch2, Radius=Slider(0.123, range=0..0.3), Caps=2)  # -> flatten(Pipe)
# enable to check how large vertex spheres are
move = Move(Geometry=msphere, Motion=bang.Branch1)  # -> Geometry, Transform; disabled
pdecon = Deconstruct(Point=bang.Branch1)  # -> XComponent, YComponent, ZComponent
mjoin = MeshJoin(Meshes=pipe)
panel_22 = Panel(pdecon.YComponent)
panel_23 = Panel(pdecon.XComponent)
panel_24 = Panel(pdecon.ZComponent)
